# Grasshopper definition CaptureTool.gh (Grasshopper 1.0.7)
# plug-ins: Cinnamon

# ----
# 1
capture = Button()
# COPY AND PASTE ME
# TO MAKE CAPTURING EASY
# CAPTURE TOOL
set_me_for_object = Guid()

# ---- group: CAPTURE
nextcapture = NextCapture(ObjectId=set_me_for_object, Reset=capture)
capture_2 = Capture(ObjectId=set_me_for_object, Capture=nextcapture, Save=capture)
savedobjectcaptures = SavedObjectCaptures(ObjectId=set_me_for_object, Reset=capture)

# ----
# PREVIEW CAPTURE
id = Guid(set_me_for_object)
previewcapture = Slider(1, range=0..10)
enabled_preview = BooleanToggle(False)

gate = StreamGate(Stream=previewcapture, Gate=enabled_preview)  # -> Target0, Target1
previewcapture_2 = PreviewCapture(ObjectId=id, Capture=gate.Target1)

interpolated_curve = BooleanToggle(False)
all_captures = Panel(savedobjectcaptures)
skip = Panel("")
override = Panel("")
cluster = Object(A=all_captures, L=override, B=skip, _0=override)
animatecaptures = AnimateCaptures(ObjectId=graft(set_me_for_object), Captures=cluster, Interpolate=interpolated_curve)

# ----
# ANIMATE CAPTURE TOOL
effect = Data(flatten(animatecaptures))

# ---- group: OUTPUT
effect_2 = Data(effect)

# ---- group: START / END IN SECONDS
number_slider = Slider(0, range=0..30)
number_slider_2 = Slider(3, range=0..30)

# ----
# 2
effect_3 = Data()

# ----
# PREVIEW EFFECT
number_slider_3 = Slider(0, range=0..1)
player = Player(Movie=effect_3, Seek=number_slider_3, ByFrame=False)

# ----
# 5
movie = Data()

# ----
# PLAY MOVIE
number_slider_4 = Slider(0, range=0..1)
by_frame = BooleanToggle(False)
player_2 = Player(Movie=movie, Seek=number_slider_4, ByFrame=by_frame)

# ----
# 3
effects = Data()

# ----
# CREATE MOMENT & SCENE
timerangese = TimeRangeStartEnd(Start=number_slider, End=number_slider_2)
createmoment = CreateMoment(Effects=flatten(effects), Style=3, TimeRange=timerangese)
createscene = CreateScene(Name="New Scene", Moments=createmoment)

scene = Data(createscene)

# ----
# 4
scene_2 = Data()
play_all_at_once = BooleanToggle(False)
gap_seconds = Slider(2, range=0..5)
end_pause_seconds = Slider(2, range=0..5)

# ----
# MERGE SCENES INTO MOVIE
combinescenes = CombineScenes(Scenes=scene_2, CompilationStrategy=play_all_at_once, Gap=gap_seconds)
buildmovie = BuildMovie(Scenes=combinescenes, Fps=Slider(30, range=15..60), EndPause=end_pause_seconds)  # -> Movie, FrameCount

movie_2 = Data(buildmovie.Movie)

# ==== cluster Object
_0 = ClusterInput()
A = ClusterInput()
B = ClusterInput()
L = ClusterInput()
difference = SetDifference(SetA=A, SetB=B)
lng = ListLength(List=L)
equals = Equality(FirstNumber=expr("x-1", lng), SecondNumber=0)  # -> Equality, Inequality
filter = StreamFilter(Gate=equals.Equality, Stream0=_0, Stream1=difference)
int = Integer(filter)
int_2 = ClusterOutput(int)
