# Grasshopper definition CinnamonTests.gh (Grasshopper 1.0.7)
# plug-ins: Cinnamon

saved_cameras = CSharpScript()

button = Button()
nextorder = NextOrder(Reset=button)
savecameralocation = SaveCameraLocation(Order=nextorder, Save=button)

save_camera_location = CSharpScript(Order="1", Save=Button())
savecameralocation_2 = SaveCameraLocation(Order=0, Save=Button())
buildcamerawork = CSharpScript(OrderStart="1", OrderEnd="5")
load_camera = CSharpScript(Order="1")
timerangese = TimeRangeStartEnd(Start=Slider(0, range=0..100), End=Slider(17, range=0..100))
changelenslength = ChangeLensLength(Start=Slider(2000, range=0..5000), End=Slider(10, range=0..30))
previewcamera = PreviewCamera(Order=Slider(1, range=0..10))
createmoment = CreateMoment(Effects=changelenslength, Curve="Linear", TimeRange=timerangese)
createscene = CreateScene(Name="First Scene", Moments=createmoment)
buildmovie = BuildMovie(Scenes=createscene, Fps="30", Reset=Button())  # -> Movie, FrameCount
total_frames = Panel(buildmovie.FrameCount)
player = Player(Movie=buildmovie.Movie, Seek=Slider(0, range=0..1), ByFrame=False)
