# Grasshopper definition ClippingPlaneTest.gh (Grasshopper 1.0.7)
# plug-ins: Cinnamon

guid = Guid()
guid_2 = Guid()
panel = Panel(guid)
panel_2 = Panel(guid_2)

previeworder = PreviewOrder(ObjectId=panel_2, Order=Slider(0, range=0..5))

button = Button()
nextorder = NextOrder(Reset=button)
savecameralocation = SaveCameraLocation(Order=nextorder, Save=button)
previewcamera = PreviewCamera(Order=Slider(0, range=0..5))
savedcameras = SavedCameras(Reset=button)
movementfromorders = MovementFromOrders(Orders=savedcameras, Interpolate=False)
timerange_start_duration = TimeRangeStartDuration(Start="0", Duration="3")
createmoment = CreateMoment(Effects=movementfromorders, Style="Linear", TimeRange=timerange_start_duration)
createscene = CreateScene(Name="Scene 1", Moments=createmoment)
number_slider = Slider(0.486, range=0..1)
buildmovie = BuildMovie(Scenes=createscene, Fps=30, Reset=False)  # -> Movie, FrameCount
player = Player(Movie=buildmovie.Movie, Seek=0, ByFrame=False)  # disabled

button_2 = Button()

nextorder_2 = NextOrder(Id=panel, Reset=button_2)

saveobjectorder = SaveObjectOrder(ObjectId=panel, Order=nextorder_2, Save=button_2)

button_3 = Button()

nextorder_3 = NextOrder(Id=panel_2, Reset=button_3)

saveobjectorder_2 = SaveObjectOrder(ObjectId=panel_2, Order=nextorder_3, Save=button_3)
