# Grasshopper definition Example.gh (Grasshopper 1.0.7)
# plug-ins: Cinnamon

# ---- group: Object To Move
guid = Guid(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)

guid_2 = Guid(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)

# ---- group: Save Object Position
guid_3 = Guid(guid)
save = Button()
nextorder = NextOrder(Id=guid_3, Reset=save)
saveobjectorder = SaveObjectOrder(ObjectId=guid_3, Order=nextorder, Save=save)

# ---- group: Save Camera Props
save_2 = Button()
nextorder_2 = NextOrder(Reset=save_2)
savecameralocation = SaveCameraLocation(Order=nextorder_2, Save=save_2)

# ---- group: Save Object Position
guid_4 = Guid(guid_2)
save_3 = Button()
nextorder_3 = NextOrder(Id=guid_4, Reset=save_3)
saveobjectorder_2 = SaveObjectOrder(ObjectId=guid_4, Order=nextorder_3, Save=save_3)

# ---- group: Create Effect of Moving Object From Orders
guid_5 = Guid(guid)
savedobjectorders = SavedObjectOrders(ObjectId=guid_5, Reset=save)
movementfromorders = MovementFromOrders(ObjectId=guid_5, Orders=savedobjectorders, Interpolate=True)

guid_6 = Guid(guid_2)
savedobjectorders_2 = SavedObjectOrders(ObjectId=guid_6, Reset=save_3)
movementfromorders_2 = MovementFromOrders(ObjectId=guid_6, Orders=savedobjectorders_2, Interpolate=False)

# ---- group: Create Effect of Moving Camera From Orders
savedcameras = SavedCameras(Reset=save_2)
movementfromorders_3 = MovementFromOrders(Orders=savedcameras, Interpolate=False)

# ----
previeworder = PreviewOrder(ObjectId=guid_5, Order=Slider(3, range=0..3))

# ---- group: Create Moment
timerange_start_duration = TimeRangeStartDuration(Start="0", Duration="3")
createmoment = CreateMoment(
    Effects=simplify(flatten([movementfromorders_2, movementfromorders_3, movementfromorders])),
    Style=0,
    TimeRange=timerange_start_duration)

# ---- group: Create Scene
createscene = CreateScene(Name="New Scene", Moments=createmoment)

createscene_2 = CreateScene(Name="New Scene", Moments=createmoment)

# ----
combinescenes = CombineScenes(Scenes=[createscene, createscene_2], CompilationStrategy=0)

# ---- group: Create Movie
buildmovie = BuildMovie(Scenes=createscene, Fps="30", Reset=False)  # -> Movie, FrameCount

# ---- group: Play Movie
player = Player(Movie=buildmovie.Movie, Seek=Slider(0.833, range=0..1), ByFrame=False)
