# Grasshopper definition ExampleFile.gh (Grasshopper 1.0.7)
# plug-ins: Cinnamon

# ----
# 1
capture = Button()
# CAPTURE TOOL
set_me_for_object = Guid([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])

# ----
# 1
capture_2 = Button()
# CAPTURE TOOL
set_me_for_object_2 = Guid([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])

# ----
# 1
capture_3 = Button()
# CAPTURE TOOL
set_me_for_object_3 = Guid(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)

# ----
# 1
capture_4 = Button()
# CAPTURE TOOL
set_me_for_object_4 = Guid()

# ----
# 1
capture_5 = Button()
# CAPTURE TOOL
set_me_for_object_5 = Guid()

# ----
# 1
capture_6 = Button()
# CAPTURE TOOL
set_me_for_object_6 = Guid()

# ---- group: CAPTURE
nextcapture = NextCapture(ObjectId=set_me_for_object, Reset=capture)
capture_7 = Capture(ObjectId=set_me_for_object, Capture=nextcapture, Save=capture)
savedobjectcaptures = SavedObjectCaptures(ObjectId=set_me_for_object, Reset=capture)

nextcapture_2 = NextCapture(ObjectId=set_me_for_object_2, Reset=capture_2)
capture_8 = Capture(ObjectId=set_me_for_object_2, Capture=nextcapture_2, Save=capture_2)
savedobjectcaptures_2 = SavedObjectCaptures(ObjectId=set_me_for_object_2, Reset=capture_2)

# ----
# PREVIEW CAPTURE
id = Guid(set_me_for_object)
enabled_preview = BooleanToggle(False)
previewcapture = Slider(0, range=0..10)

# ---- group: CAPTURE
nextcapture_3 = NextCapture(ObjectId=set_me_for_object_3, Reset=capture_3)
capture_9 = Capture(ObjectId=set_me_for_object_3, Capture=nextcapture_3, Save=capture_3)
savedobjectcaptures_3 = SavedObjectCaptures(ObjectId=set_me_for_object_3, Reset=capture_3)

# ----
# PREVIEW CAPTURE
enabled_preview_2 = BooleanToggle(False)
id_2 = Guid(set_me_for_object_2)
previewcapture_2 = Slider(1, range=0..10)

# ----
# PREVIEW CAPTURE
id_3 = Guid(set_me_for_object_3)
enabled_preview_3 = BooleanToggle(False)
previewcapture_3 = Slider(0, range=0..10)

# ---- group: CAPTURE
nextcapture_4 = NextCapture(ObjectId=set_me_for_object_4, Reset=capture_4)
capture_10 = Capture(ObjectId=set_me_for_object_4, Capture=nextcapture_4, Save=capture_4)
savedobjectcaptures_4 = SavedObjectCaptures(ObjectId=set_me_for_object_4, Reset=capture_4)

nextcapture_5 = NextCapture(ObjectId=set_me_for_object_5, Reset=capture_5)
capture_11 = Capture(ObjectId=set_me_for_object_5, Capture=nextcapture_5, Save=capture_5)
savedobjectcaptures_5 = SavedObjectCaptures(ObjectId=set_me_for_object_5, Reset=capture_5)

nextcapture_6 = NextCapture(ObjectId=set_me_for_object_6, Reset=capture_6)
capture_12 = Capture(ObjectId=set_me_for_object_6, Capture=nextcapture_6, Save=capture_6)
savedobjectcaptures_6 = SavedObjectCaptures(ObjectId=set_me_for_object_6, Reset=capture_6)

# ----
# PREVIEW CAPTURE
enabled_preview_4 = BooleanToggle(False)
id_4 = Guid(set_me_for_object_4)
previewcapture_4 = Slider(0, range=0..10)

# ----
# PREVIEW CAPTURE
enabled_preview_5 = BooleanToggle(False)
id_5 = Guid(set_me_for_object_5)
previewcapture_5 = Slider(0, range=0..10)

# ----
# PREVIEW CAPTURE
enabled_preview_6 = BooleanToggle(False)
id_6 = Guid(set_me_for_object_6)
previewcapture_6 = Slider(0, range=0..10)

gate = StreamGate(Stream=previewcapture, Gate=enabled_preview)  # -> Target0, Target1
previewcapture_7 = PreviewCapture(ObjectId=id, Capture=gate.Target1)

gate_2 = StreamGate(Stream=previewcapture_2, Gate=enabled_preview_2)  # -> Target0, Target1
previewcapture_8 = PreviewCapture(ObjectId=id_2, Capture=gate_2.Target1)

gate_3 = StreamGate(Stream=previewcapture_3, Gate=enabled_preview_3)  # -> Target0, Target1
previewcapture_9 = PreviewCapture(ObjectId=id_3, Capture=gate_3.Target1)

gate_4 = StreamGate(Stream=previewcapture_4, Gate=enabled_preview_4)  # -> Target0, Target1
previewcapture_10 = PreviewCapture(ObjectId=id_4, Capture=gate_4.Target1)

gate_5 = StreamGate(Stream=previewcapture_5, Gate=enabled_preview_5)  # -> Target0, Target1
previewcapture_11 = PreviewCapture(ObjectId=id_5, Capture=gate_5.Target1)

gate_6 = StreamGate(Stream=previewcapture_6, Gate=enabled_preview_6)  # -> Target0, Target1
previewcapture_12 = PreviewCapture(ObjectId=id_6, Capture=gate_6.Target1)

interpolated_curve = BooleanToggle(False)
all_captures = Panel(savedobjectcaptures)
skip = Panel("")
override = Panel("")
cluster = Object(A=all_captures, L=override, B=skip, _0=override)
animatecaptures = AnimateCaptures(ObjectId=graft(set_me_for_object), Captures=cluster, Interpolate=interpolated_curve)

interpolated_curve_2 = BooleanToggle(False)
all_captures_2 = Panel(savedobjectcaptures_2)
skip_2 = Panel("")
override_2 = Panel("""1
0""")
cluster_2 = Object(A=all_captures_2, L=override_2, B=skip_2, _0=override_2)
animatecaptures_2 = AnimateCaptures(ObjectId=graft(set_me_for_object_2), Captures=cluster_2, Interpolate=interpolated_curve_2)

interpolated_curve_3 = BooleanToggle(False)
all_captures_3 = Panel(savedobjectcaptures_3)
skip_3 = Panel("")
override_3 = Panel("")
cluster_3 = Object(A=all_captures_3, L=override_3, B=skip_3, _0=override_3)
animatecaptures_3 = AnimateCaptures(ObjectId=set_me_for_object_3, Captures=cluster_3, Interpolate=interpolated_curve_3)

interpolated_curve_4 = BooleanToggle(False)
all_captures_4 = Panel(savedobjectcaptures_4)
skip_4 = Panel("")
override_4 = Panel("""0
3""")
cluster_4 = Object(A=all_captures_4, L=override_4, B=skip_4, _0=override_4)
animatecaptures_4 = AnimateCaptures(ObjectId=set_me_for_object_4, Captures=cluster_4, Interpolate=interpolated_curve_4)

interpolated_curve_5 = BooleanToggle(False)
all_captures_5 = Panel(savedobjectcaptures_5)
skip_5 = Panel("")
override_5 = Panel("""1
2""")
cluster_5 = Object(A=all_captures_5, L=override_5, B=skip_5, _0=override_5)
animatecaptures_5 = AnimateCaptures(ObjectId=set_me_for_object_5, Captures=cluster_5, Interpolate=interpolated_curve_5)

interpolated_curve_6 = BooleanToggle(False)
all_captures_6 = Panel(savedobjectcaptures_6)
skip_6 = Panel("")
override_6 = Panel("""3
1""")
cluster_6 = Object(A=all_captures_6, L=override_6, B=skip_6, _0=override_6)
animatecaptures_6 = AnimateCaptures(ObjectId=set_me_for_object_6, Captures=cluster_6, Interpolate=interpolated_curve_6)

# ----
# ANIMATE CAPTURE TOOL
effect = Data(flatten(animatecaptures))

# ----
# ANIMATE CAPTURE TOOL
effect_2 = Data(flatten(animatecaptures_2))

# ----
# ANIMATE CAPTURE TOOL
effect_3 = Data(animatecaptures_3)

# ----
# ANIMATE CAPTURE TOOL
effect_4 = Data(animatecaptures_4)

# ----
# ANIMATE CAPTURE TOOL
effect_5 = Data(animatecaptures_5)

# ---- group: OUTPUT
effect_6 = Data(effect)

# ----
# ANIMATE CAPTURE TOOL
effect_7 = Data(animatecaptures_6)

# ---- group: OUTPUT
effect_8 = Data(effect_2)

effect_9 = Data(effect_3)

effect_10 = Data(effect_4)

effect_11 = Data(effect_5)

effect_12 = Data(effect_7)

# ---- group: START / END IN SECONDS
number_slider = Slider(16.3, range=0..30)
number_slider_2 = Slider(19.3, range=0..30)

number_slider_3 = Slider(4.7, range=0..30)
number_slider_4 = Slider(8.1, range=0..30)

number_slider_5 = Slider(10.1, range=0..30)
number_slider_6 = Slider(14.3, range=0..30)

number_slider_7 = Slider(21.2, range=0..30)
number_slider_8 = Slider(23.7, range=0..30)

number_slider_9 = Slider(13.6, range=0..30)
number_slider_10 = Slider(14.5, range=0..30)

number_slider_11 = Slider(0, range=0..30)
number_slider_12 = Slider(3.5, range=0..30)

# ----
# 3
effects = Data(effect_11)

# ----
# CREATE MOMENT & SCENE
timerangese = TimeRangeStartEnd(Start=number_slider, End=number_slider_2)
createmoment = CreateMoment(Effects=flatten(effects), Style=3, TimeRange=timerangese)
createscene = CreateScene(Name="New Scene", Moments=createmoment)

scene = Data(createscene)

# ----
# 3
effects_2 = Data(effect_10)

# ----
# CREATE MOMENT & SCENE
timerangese_2 = TimeRangeStartEnd(Start=number_slider_3, End=number_slider_4)
createmoment_2 = CreateMoment(Effects=flatten(effects_2), Style=3, TimeRange=timerangese_2)
createscene_2 = CreateScene(Name="New Scene", Moments=createmoment_2)

scene_2 = Data(createscene_2)

# ----
# 3
effects_3 = Data(effect_12)

# ----
# CREATE MOMENT & SCENE
timerangese_3 = TimeRangeStartEnd(Start=number_slider_5, End=number_slider_6)
createmoment_3 = CreateMoment(Effects=flatten(effects_3), Style=3, TimeRange=timerangese_3)
createscene_3 = CreateScene(Name="New Scene", Moments=createmoment_3)

scene_3 = Data(createscene_3)

# ----
# 3
effects_4 = Data(effect_9)

# ----
# CREATE MOMENT & SCENE
timerangese_4 = TimeRangeStartEnd(Start=number_slider_7, End=number_slider_8)
createmoment_4 = CreateMoment(Effects=flatten(effects_4), Style=3, TimeRange=timerangese_4)
createscene_4 = CreateScene(Name="New Scene", Moments=createmoment_4)

scene_4 = Data(createscene_4)

# ----
# 3
effects_5 = Data(effect_8)

# ----
# CREATE MOMENT & SCENE
timerangese_5 = TimeRangeStartEnd(Start=number_slider_9, End=number_slider_10)
createmoment_5 = CreateMoment(Effects=flatten(effects_5), Style=3, TimeRange=timerangese_5)
createscene_5 = CreateScene(Name="New Scene", Moments=createmoment_5)

scene_5 = Data(createscene_5)

# ----
# 3
effects_6 = Data(effect_6)

# ----
# CREATE MOMENT & SCENE
timerangese_6 = TimeRangeStartEnd(Start=number_slider_11, End=number_slider_12)
createmoment_6 = CreateMoment(Effects=flatten(effects_6), Style=3, TimeRange=timerangese_6)
createscene_6 = CreateScene(Name="New Scene", Moments=createmoment_6)

scene_6 = Data(createscene_6)

# ----
# 4
scene_7 = Data([scene_2, scene_4, scene_6, scene, scene_3, scene_5])
play_all_at_once = BooleanToggle(True)
gap_seconds = Slider(1, range=0..5)
end_pause_seconds = Slider(1, range=0..5)

# ----
# MERGE SCENES INTO MOVIE
combinescenes = CombineScenes(Scenes=scene_7, CompilationStrategy=play_all_at_once, Gap=gap_seconds)
buildmovie = BuildMovie(Scenes=combinescenes, Fps=Slider(30, range=15..60), EndPause=end_pause_seconds)  # -> Movie, FrameCount

movie = Data(buildmovie.Movie)

# ----
# 5
movie_2 = Data(movie)

# ----
# PLAY MOVIE
by_frame = BooleanToggle(False)
player = Player(Movie=movie_2, Seek=Slider(0, range=0..1), ByFrame=by_frame)

# ==== cluster Object
_0 = ClusterInput()
A = ClusterInput()
B = ClusterInput()
L = ClusterInput()
difference = SetDifference(SetA=A, SetB=B)
lng = ListLength(List=L)
equals = Equality(FirstNumber=expr("x-1", lng), SecondNumber=0)  # -> Equality, Inequality
filter = StreamFilter(Gate=equals.Equality, Stream0=_0, Stream1=difference)
int = Integer(filter)
int_2 = ClusterOutput(int)
