# Grasshopper definition LayerVisibilityExample.gh (Grasshopper 1.0.7)
# plug-ins: Cinnamon

# ---- group: First layer settings
panel = Panel("""Layer 01
Layer 02""")
panel_2 = Panel("""true
false""")
changelayervisibility = ChangeLayerVisibility(Layers=panel, States=panel_2, HideOthers=False)

# ---- group: Second Layer Settings
panel_3 = Panel("""Layer 01
Layer 02""")
panel_4 = Panel("""true
false""")
changelayervisibility_2 = ChangeLayerVisibility(Layers=panel_3, States=reverse(panel_4), HideOthers=False)

# ---- group: Apply time to effects with moments
timerange_start_end = TimeRangeStartEnd(Start="0", End="3")
createmoment = CreateMoment(Effects=flatten(changelayervisibility_2), Style=0, TimeRange=timerange_start_end)
createmoment_2 = CreateMoment(Effects=flatten(changelayervisibility), Style=0, TimeRange=timerange_start_end)
createscene = CreateScene(Name="New Scene", Moments=createmoment_2)
createscene_2 = CreateScene(Name="New Scene", Moments=createmoment)

# ---- group: Create scenes, combine and build movie
combinescenes = CombineScenes(Scenes=[createscene, createscene_2], CompilationStrategy=0, Gap=3)
buildmovie = BuildMovie(Scenes=combinescenes, Fps=30)  # -> Movie, FrameCount

# ---- group: Play Movie
player = Player(Movie=buildmovie.Movie, Seek=Slider(0, range=0..1), ByFrame=False)
