# Grasshopper definition MovementTest.gh (Grasshopper 1.0.7)
# plug-ins: Cinnamon

panel = Panel("Default")
guid = Guid(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)
moveobjectoncurve = MoveObjectOnCurve(ObjectId=guid, LocationCurve=<geometry referenced from the Rhino model>)
timerange_start_duration = TimeRangeStartDuration(Start=0, Duration=1)
panel_2 = Panel("EaseInOut")
restore = Restore(Restore=Button())
createmoment = CreateMoment(Effects=flatten(moveobjectoncurve), Style="Linear", TimeRange=timerange_start_duration)
createscene = CreateScene(Name="Default", Moments=createmoment)
buildmovie = BuildMovie(Scenes=createscene, Fps=30, Reset=False)  # -> Movie, FrameCount
player = Player(Movie=buildmovie.Movie, Seek=Slider(1, range=0..1), ByFrame=False)
